% Simulink data dictionary controlador_modelo_bike-23a.sldd

stanley_kpfw = Simulink.Parameter(5)
stanley_kprv = Simulink.Parameter(5, Unit="m")
wheelbase = Simulink.Parameter(1.6)
max_steering_angle = Simulink.Parameter(36, Unit="degree")
constans_PID = Simulink.Parameter([1 1 0.2 100])
aceleracao_lateral_max = Simulink.Parameter(4)
lowest_curvature = Simulink.Parameter(1.0e-6)
max_velocity_longitudinal = Simulink.Parameter(1)