% Simulink data dictionary controle_autonomo_dict_23a.sldd
% references controlador_modelo_bike.sldd

bus_imu = Simulink.Bus()
  pos_x: double
  pos_y: double
  pos_theta: double
  vel_x: double
  vel_y: double
  vel_yaw: double

bus_route = Simulink.Bus()
  desired_x: double
  desired_y: double
  desired_yaw: double