# Requirement set controle_documento (R2023a)

## 1 [Frenagem] Requisitios relativos ao sistema de freios (Container)

### 1.1 [arquitetura do EBS]
O veiculo deve possuir um sistema de frenagem de emergencia

### 1.2 [sistema de freio de emergencia]
o sistema deve ser acionado quando houver um obstaculo detectado pelo box

#### 1.2.1 [Funcionamento EBS] Em caso de emergencia um EBS_signal baixo oriundo do box deve acionar a EBS_solenoide

## 2 [Esterçamento] (Container)

### 2.1 [Limite de esterçamento] O veiculo deve esterçar no maximo de -36 a 36 graus +/- 0.1 grau

## 3 [Longitudinal]

### 3.1 [settling time] o settling time nao deve ser maio que 1.5 segundos

### 3.2 [overshoot] o overshoot nao pode ser maior que 2 porcento

### 3.3 [percent rise] o percent rise deve ser igual ou maior que 80 porcento

### 3.4 [rise time] o rise time deve ser igual ou menor que 1 segundo

### 3.5 [percent settling] o percent settling deve ser igual ou menor que 1 porcento

### 3.6 [undershoot] o undershoot deve ser igual ou menor que 3 porcento