% Simulink data dictionary implementacao_deploy.sldd
% references controle_autonomo_dict.sldd
% references controlador_modelo_bike.sldd

ts_can_5ms = Simulink.Parameter(0.005)
ts_can_10ms = Simulink.Parameter(0.01)
ts_can_25ms = Simulink.Parameter(0.025)
ts_ros2 = Simulink.Parameter(0.005)
Configuration = Simulink.ConfigSet(StartTime="0", StopTime="inf", Solver="FixedStepAuto", ProdHWDeviceType="ARM Compatible->ARM 8", SystemTargetFile="ert.tlc", HardwareBoard="Robot Operating System 2 (ROS 2)", TargetLang="C++")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
massa = 230
distancia_eixo_frontal_centro_massa = 0.84
distancia_eixo_ftraseiro_centro_massa = 0.64
inercial_polar_yaw = 150
Ts = 0.05
PredictionHorizon = 30