% Simulink data dictionary implementacao_deploy_23a.sldd
% references controle_autonomo_dict.sldd
% references controlador_modelo_bike.sldd

ts_can_5ms = Simulink.Parameter(0.005)
ts_can_10ms = Simulink.Parameter(0.01)
ts_can_25ms = Simulink.Parameter(0.025)
ts_ros2 = Simulink.Parameter(0.005)
massa = 230
distancia_eixo_frontal_centro_massa = 0.84
distancia_eixo_ftraseiro_centro_massa = 0.64
inercial_polar_yaw = 150
Ts = 0.05
PredictionHorizon = 30