% Simulink data dictionary modelo_bike_r23a.sldd

numero_de_eixos_frente = Simulink.Parameter(2)
numero_de_eixos_traseira = Simulink.Parameter(2)
massa = Simulink.Parameter(230, Unit="kg")
distancia_eixo_frontal_centro_massa = Simulink.Parameter(0.84, Unit="m")
distancia_eixo_ftraseiro_centro_massa = Simulink.Parameter(0.68)
distancia_chao_plano_centro_massa = Simulink.Parameter(0.28)
distancia_lateral_linha_gemetrica_centro_massa = Simulink.Parameter(0)
rigidez_lateral_pneu_frontal = Simulink.Parameter(60000)
rigidez_lateral_pneu_traseira = Simulink.Parameter(70000)
comprimento_relaxacao_frontal = Simulink.Parameter(0.1)
comprimento_relaxacao_traseira = Simulink.Parameter(0.1)
velocidade_inicial = Simulink.Parameter(0)
inercial_polar_yaw = Simulink.Parameter(150)
giro_yaw_inicial = Simulink.Parameter(0)
area_arrasto_longitudinal = Simulink.Parameter(1.22)
coeficiente_longitudinal_arrasto = Simulink.Parameter(1.1)
coefficient_longitudinal_sustentacao = Simulink.Parameter(2)
arrasto_longitudinal_pitch = Simulink.Parameter(0.1)
angulo_relativo_vento_vetor = Simulink.Parameter([0 0.01 0.02 0.03 0.04 0.05 0.06 0.07 0.08 0.09 0.1 0.11 0.12 0.13 0.14 0.15 0.16 0.17 0.18 0.19 0.2 0.21 0.22 0.23 0.24 0.25 0.26 0.27 0.28 0.29 0.3])
vetor_yaw_momento_coeficiente = Simulink.Parameter([0 0.01 0.02 0.03 0.04 0.05 0.06 0.07 0.08 0.09 0.1 0.11 0.12 0.13 0.14 0.15 0.16 0.17 0.18 0.19 0.2 0.21 0.22 0.23 0.24 0.25 0.26 0.27 0.28 0.29 0.3])
vetor_coeficiente_forca_lateral = Simulink.Parameter([0 0.03 0.06 0.09 0.12 0.15 0.18 0.21 0.24 0.27 0.3 0.33 0.36 0.39 0.42 0.45 0.48 0.51 0.54 0.57 0.6 0.63 0.66 0.69 0.72 0.75 0.78 0.81 0.84 0.87 0.9])
bitola = Simulink.Parameter([1 1.1])
wheelbase = Simulink.Parameter(1.6)
max_steering_angle = Simulink.Parameter(36, Unit="degree")
constans_PID = Simulink.Parameter([1 1 0.2 100])
aceleracao_lateral_max = Simulink.Parameter(4)
lowest_curvature = Simulink.Parameter(1.0e-6)
max_velocity_longitudinal = Simulink.Parameter(8)
filtro_coeficiente = Simulink.Parameter(0.8558606)
Var = 0
rise_time = 1
settling_time = 1.5
overshoot = 2
rise = 80
settling = 1
undershoot = 3
p_gain = 43.653
i_gain = 3.6015
d_gain = 1
ganho_yaw_rate = 0.0001319604
ganho_steering = 0.08022896